# Grasshopper definition Jaime Cordero_Assignment 1.gh (Grasshopper 1.0.7)

# ----
# 1. list
series = Series(Start=0, Step=1, Count=10)

# ----
# 2. points
pt = ConstructPoint(XCoordinate=series, YCoordinate=0, ZCoordinate=0)
pt_2 = ConstructPoint(XCoordinate=series, YCoordinate=Slider(10, range=0..10), ZCoordinate=0)

# ----
# 3. lines
ln = Line(StartPoint=pt, EndPoint=pt_2)

# ----
# 4. divide curve
divide = DivideCurve(Curve=ln, Count=10, Kinks=False)  # -> Points, Tangents, Parameters

meshlen = Slider(0, range=0..1)
z = Slider(0.4, range=0..2)
degree = Slider(3, range=1..9)
meshdens = Slider(1, range=0..1)

# ----
# 5. move vector
vec = Vector(divide.Points)
vlen = VectorLength(Vector=vec)
sin = Sine(Value=vlen)
Z = UnitZ(Factor=sin)
move = Move(Geometry=divide.Points, Motion=Z)  # -> Geometry, Transform

python = GhPythonScript(
    x_count=Slider(10, range=0..10),
    y=Slider(10, range=0..10),
    y_div=Slider(10, range=0..10),
    z=z,
    degree=degree,
    meshDens=meshdens,
    meshLen=meshlen,
    U=Slider(10, range=0..10),
    V=Slider(10, range=0..10))  # -> out, ptsA, ptsB, lines, divPoints, movedPoints, nurbs, surface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; inputs x_count: Int32, y: Int32, degree: Int32, meshDens: Int32, U: Int32, V: Int32
# ---------- python: Python ----------
import Rhino.Geometry as rg
import ghpythonlib.treehelpers as th
import math
import ghpythonlib.components as ghc #importing grasshopper components

#---------- 1. Creating first array of points ----------#

pointList = []

for i in range(x_count):
    #print(i)
    p = rg.Point3d(i,0,0)
    pointList.append(p)
    #print(len(pointList)

ptsA = pointList

#---------- 2. Creating second array of points ----------#

pointList2 = []

for i in range(x_count):
    q = rg.Point3d(i,y,0)
    pointList2.append(q)
    #print(len(pointList2)

ptsB = pointList2

#---------- 3. Connecting two list of points and creating lines ----------#

lineList = []

for i in range(len(pointList)):
    l = rg.Line(pointList[i],pointList2[i])
    lineList.append(l)

lines = lineList

#---------- 4. Dividing lines (curves) ----------#

points = []

for line in lineList:
    nc = line.ToNurbsCurve()
    divPar = nc.DivideByCount(y_div,True)
    divList = []
    for j in divPar:
        divPts = nc.PointAt(j)
        divList.append(divPts)
    points.append(divList)

#print(divList)
#print(type(points))

divPoints = th.list_to_tree(points)

#---------- 5. Moving points by sine function ----------#

allMovedPts = []
for i in points:
    movedPts = []
    for pt in i:
        vector = rg.Vector3d(pt)
        length = vector.Length
        zVector = z*math.sin(length)
        newPt = pt - rg.Vector3d(0,0,zVector)
        movedPts.append(newPt)
    allMovedPts.append(movedPts)

movedPoints = th.list_to_tree(allMovedPts)

#---------- 6. Interpolate points by tree ----------#

curves = []

for pts in allMovedPts:
    crv = rg.Curve.CreateInterpolatedCurve(pts,degree)
    curves.append(crv)

nurbs = curves

#---------- 7. Loft curves ----------#

srf = rg.Brep.CreateFromLoft(curves,rg.Point3d.Unset,rg.Point3d.Unset,0,False)
surface = srf

#---------- 8. Brep to mesh ----------#

msh = rg.Mesh.CreateFromBrep(srf[0],rg.MeshingParameters(meshDens,meshLen))
mesh = msh

ghmsh = ghc.MeshSurface(srf[0], U, V, True, False)
ghmesh = ghmsh

#---------- 9. Trying to divide mesh ----------#

pts = {}
srfs = []
grid = []

nrows = U
ncolumns = V

UDomain = rg.Interval(0,U)
VDomain = rg.Interval(0,V)

UVsrf = srf[0].Faces[0]

UVsrf.SetDomain(0,UDomain)
UVsrf.SetDomain(1,VDomain)

for i in range(0,nrows+1):
    gcolumn = []
    for j in range(0,ncolumns+1):
        pts[(i,j)] = rg.Surface.PointAt(UVsrf,i,j)
        gcolumn.append(rg.Surface.PointAt(UVsrf,i,j))
    grid.append(gcolumn)
  
for i in range(0, nrows):
    pcolumn = []
    for j in range(0, ncolumns):
        panel = rg.NurbsSurface.CreateFromCorners(pts[i,j],pts[i+1,j],pts[i+1,j+1],pts[i,j+1])
        pcolumn.append(panel)
    srfs.append(pcolumn)

UVsurfaces = th.list_to_tree(srfs)
UVgrid = th.list_to_tree(grid)

meshes = []

for i in srfs:
#    print(type(i))
    UVmeshes = []
    for j in i:
        UVmsh = rg.Mesh.CreateFromSurface(j)
        UVmeshes.append(UVmsh)
    meshes.append(UVmeshes)

#print(type(meshes))
UVmesh = th.list_to_tree(meshes) #not smooth enough, trying to create it by lines but not succeeded

"""UmeshLines = []
VmeshLines = []

for i in range(0, nrows):
    Ulines = []
    Vlines = []
    for j in range(0, ncolumns):
        Ul = rg.Line(pts[i,j],pts[i+1,j])
        Vl = rg.Line(pts[i+1,j+1],pts[i,j+1])
        Ulines.append(Ul)
        Vlines.append(Vl)
    UmeshLines.append(Ulines)
    VmeshLines.append(Vlines)

UmshLines = th.list_to_tree(UmeshLines)
VmshLines = th.list_to_tree(VmeshLines)

for lines in UmeshLines:
    crv = lines[i].ToNurbsCurve()
    rg.Mesh.CreateFromLines(crv[i],4,1)"""
# ---------- end python ----------
panel = Panel(python.out)
# #Creating UV Divisions and panel list
# for u in range(uDiv):
#     for v in range(vDiv): #going in the clockwise direction
#         p1 = surface.PointAt(u/uDiv, v/vDiv)
#         p2 = surface.PointAt((u+1)/uDiv, v/vDiv)
#         p3 = surface.PointAt((u+1)/uDiv, (v+1)/vDiv)
#         p4 = surface.PointAt(u/uDiv, (v+1)/vDiv)
#         panel = rg.NurbsSurface.CreateFromCorners(p1, p2, p3, p4)
#         points.append(p1)
#         panels.append(panel)
data = Data(python.ptsB)
data_2 = Data(python.lines)
data_3 = Data(python.movedPoints)
data_4 = Data(python.nurbs)
data_5 = Data(python.surface)
data_6 = Data(python.ptsA)
data_7 = Data(python.divPoints)
data_8 = Data(python.mesh)
data_9 = Data(python.UVgrid)
data_10 = Data(python.UVmesh)
data_11 = Data(python.UVsurfaces)
data_12 = Data(python.ghmesh)

# ----
# 6. curves
nurbs = NurbsCurve(Vertices=move.Geometry, Degree=3, Periodic=False)  # -> Curve, Length, Domain

# ----
# 7. surface
loft = Loft(
    Curves=flatten(nurbs.Curve),
    Options={Adjust=False, Closed=False, LoftEnds=0, LoftSimp=0, LoftType=0, Rebuild=10, Refit=0.01})

# ----
# 8. mesh
mesh_uv = MeshSurface(Surface=loft, UCount=Slider(10, range=0..10), VCount=Slider(10, range=0..10), Overhang=True, Equalize=False)
