# Grasshopper definition Jaime Cordero_Assignment 2.gh (Grasshopper 1.0.7)

# Assignment 2
python = GhPythonScript(x=Slider(10, range=1..20), y=Slider(10, range=1..20), U=Slider(20, range=1..20), V=Slider(20, range=1..20))  # -> out, points, lines, divPoints, curves, srf, msh, cleanMesh; inputs x: Int32, U: Int32, V: Int32
# ---------- python: Python ----------
import Rhino.Geometry as rg
import ghpythonlib.treehelpers as th
import math
import ghpythonlib.components as ghc

#this is how you initialize a list in python
pointList1 = []
pointList2 = []
for i in range(x):
    pt1 = rg.Point3d(i, 0, 0)
    pt2 = rg.Point3d(i, y, 0)
    pointList1.append(pt1)
    pointList2.append(pt2)

points = pointList1

lineList = []
for i in range(len(pointList1)):
    line = rg.Line(pointList1[i], pointList2[i])
    lineList.append(line)
lines = lineList


allDivPts = []
for l in lineList:
    divPts = [] #my list of division points
    nc = l.ToNurbsCurve()
    params = nc.DivideByCount(V, True)
    for p in params:
        divPt = nc.PointAt(p)
        
        vec= rg.Vector3d(divPt)
        vecLen = vec.Length
        mag = math.sin(vecLen)
        transVec = -rg.Vector3d.ZAxis * mag
        
        newPt = divPt - transVec
        divPts.append(newPt)

    allDivPts.append(divPts)

divPoints = th.list_to_tree(allDivPts)


#make a curve from list of points
curveList = []
for i in range(len(allDivPts)):
    curve = rg.Curve.CreateInterpolatedCurve(allDivPts[i], 3)
    curveList.append(curve)

curves = curveList


#create a loft surface from curves
surface = rg.Brep.CreateFromLoft(curveList, rg.Point3d.Unset, rg.Point3d.Unset, rg.LoftType.Normal, False)
surface = surface[0].Faces[0]

srf = surface

#reparametrize surface
surface.SetDomain(0,rg.Interval(0,U))
surface.SetDomain(1,rg.Interval(0,V))

#get points
allSrfPts=[]
for i in range(U+1):
    srfPts= []
    for j in range(V+1):
        pt=rg.Surface.PointAt(surface,i,j)
        srfPts.append(pt)
    allSrfPts.append(srfPts)
srfPts = allSrfPts


mesh = rg.Mesh()
for i in range(len(allSrfPts)-1):
    for j in range(len(allSrfPts[i])-1):
        m = rg.Mesh()
        v1 = allSrfPts[i][j]
        v2 = allSrfPts[i][j+1]        
        v3 = allSrfPts[i+1][j+1]        
        v4 = allSrfPts[i+1][j]
        
        m.Vertices.Add(v1)
        m.Vertices.Add(v2)
        m.Vertices.Add(v3)
        m.Vertices.Add(v4)
        
        m.Faces.AddFace(0,1,2,3)
        
        mesh.Append(m)

msh = mesh

cleanmesh = mesh
#methods to clean a mesh
cleanmesh.Normals.ComputeNormals()
cleanmesh.Vertices.CombineIdentical(True, True)
cleanmesh.Vertices.CullUnused()
cleanmesh.Weld(3.14159265358979)
cleanmesh.UnifyNormals()
cleanmesh.FaceNormals.ComputeFaceNormals()
cleanmesh.Compact()


cleanMesh = cleanmesh
# ---------- end python ----------

# ---- group: create sun Vector
python_2 = GhPythonScript(x=Slider(0.2, range=0..1), y=Slider(0.11, range=0..1))  # -> out, sphere, pt, sun
# ---------- python_2: Python ----------
import Rhino.Geometry as rg
import math

#----------------- 1. Create a sun vector -----------------#

"""create a Sphere at point (0,0,0) with radius 1 and output it to a. 
output the sphere to a"""

sph = rg.Sphere(rg.Point3d(0,0,0),1)

sphere = sph

#----------------- 2. Evaluate sphere -----------------#

"""evaluate a point in the sphere using rg.Sphere.PointAt() at coordintes x and y.
The point should only be on the upper half of the sphere (upper hemisphere)
the angles are in radians, so you might want to use math.pi for this
output the point to b"""

point = sph.PointAt(x*2*math.pi,y*math.pi)
#srf = sph.ToNurbsSurface()
#a = srf.SetDomain(0,rg.Interval(0,1))
#e = srf.SetDomain(1,rg.Interval(-math.pi,1))
#point = srf.PointAt(x,y)

#print a
#print e

pt = point
print point

#----------------- 3. Create sun vector -----------------#

"""create a vector from the origin and reverse the vector
keep in mind that Reverse affects the original vector
output the vector to c"""

vec = rg.Vector3d(point)
vec.Reverse()

print vec
sun = vec
# ---------- end python_2 ----------

# ---- group: replaceable mesh
mesh = Data(python.cleanMesh)

# ---- group: your .py file goes here
path = FilePath("C:\Users\PC-Jaime\Documents\IAAC\3. Artificial Intelligence in Architecture\S.3 Algorithmic Geometrical Optimization\0_Assignments\a02\A02_mesh.py")

# ----
srf = Surface(python_2.sphere)
pt = Point(python_2.pt)
vdis = VectorDisplay(Anchor=python_2.pt, Vector=python_2.sun)
file = ReadFile(File=path, PerLineParse=False)
python_3 = GhPythonScript(mesh=mesh, sun=python_2.sun)  # -> out, a, b, c, d; inputs mesh: Mesh, sun: Vector3d
# ---------- python_3: Python ----------
"""Provides a scripting component.
    Inputs:
        mesh: a mesh
        sun: sun vector
    Output:
        a: List of Vectors - normals
        b: List of Points - 
        c: list of angles
        d: exploded mesh
        """
        
import Rhino.Geometry as rg

#----------------- 1. Compute Face Normals -----------------#

"""compute face normals using rg.Mesh.FaceNormals.ComputeFaceNormals()
Output the vectors to a"""

mesh.FaceNormals.ComputeFaceNormals
a = mesh.FaceNormals

#----------------- 2. Get Face centers -----------------#

"""get the centers of each faces using rg.Mesh.Faces.GetFaceCenter()
Store the centers into a list called centers 
Output that list to b"""

centers = []

for i in range(mesh.Faces.Count):
    cent = mesh.Faces.GetFaceCenter(i)
    centers.append(cent)

b = centers

#----------------- 3. Angle between sun and faceNormal -----------------#

"""calculate the angle between the sun and each FaceNormal using rg.Vector3d.VectorAngle()
#store the angles in a list called angleList and output it to c"""

"""anglesList = []
for i in range(mesh.Faces.Count):
    angles = rg.Vector3d.VectorAngle()

c = angleList"""


#4. explode the mesh - convert each face of the mesh into a mesh
#for this, you have to first copy the mesh using rg.Mesh.Duplicate()
#then iterate through each face of the copy, extract it using rg.Mesh.ExtractFaces
#and store the result into a list called exploded in output d

#d = exploded

#after here, your task is to apply a transformation to each face of the mesh
#the transformation should correspond to the angle value that corresponds that face to it... 
#the result should be a mesh that responds to the sun position... its up to you!
# ---------- end python_3 ----------
python_4 = GhPythonScript(Code=file, Mesh=mesh, Sun=python_2.sun)  # -> Out, A, B, C, D
bnd = Bounds(Numbers=python_4.C)
panel = Panel(python_4.Out)
dedomain = DeconstructDomain(Domain=bnd)  # -> Start, End
gradient = Gradient(
    LowerLimit=dedomain.Start,
    UpperLimit=dedomain.End,
    Parameter=python_4.C,
    stops=[0: RGB(234, 38, 0), 0.25: RGB(234, 126, 0), 0.5: RGB(254, 244, 84), 0.75: RGB(173, 203, 249), 1: RGB(75, 107, 169)])
preview = CustomPreview(Geometry=python_4.D, Material=gradient)
vdisex = VectorDisplayEx(Point=python_4.B, Vector=python_4.A, Colour=gradient, Width=2)
